# Grasshopper definition assignment_1_mesh_traverse.ghx (Grasshopper 1.0.7)

# ----
# Assignment Data Structures (using data/faces.obj):
# 
# Define a function for traversing the mesh from boundary
# to boundary in a "straight" line and visualise the result.
number_slider = Slider(2, range=0..19)
mesh_viz = GhPythonScript(
    show_labels_all_keys=Toggle(True),
    show_labels_boundary=Toggle(True),
    show_labels_neighbors_start=Toggle(True),
    show_labels_neighbors_current=Toggle(True),
    show_labels_path=Toggle(True),
    start_boundary_vertex_idx=number_slider)  # -> out, vertices, edges, faces, labels, start_vertex, vertices_start_neighbors, labels_start_neighbors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; inputs start_boundary_vertex_idx: Int32
# ---------- mesh_viz: Python ----------
import sys, os
import ghpythonlib.components as ghcomp
import compas
from compas.datastructures import Mesh
from compas_ghpython.artists import MeshArtist

ghComp = ghenv.Component
ghDoc = ghComp.OnPingDocument()
import Rhino.Geometry as rg

# the full path of the gh file
path_gh_file = ghDoc.FilePath

# the directory of the gh file
HERE = os.path.dirname(path_gh_file)
DATA = os.path.join(HERE, 'data')
FILE = os.path.join(DATA, 'faces.obj')

mesh = Mesh.from_obj(FILE)

artist = MeshArtist(mesh)
vertices = artist.draw_vertices()
edges = artist.draw_edges()
faces = artist.draw_faces()

# Visualize the vertices and labels
if show_labels_all_keys:
    vertices = artist.draw_vertices()
    labels = {key: key for key in mesh.vertices()}

# Visualize additionally the vertices and labels on the boundary
if show_labels_boundary:
    keys = list(mesh.vertices_on_boundary())
    vertices = artist.draw_vertices(vertices=keys)
    labels = [key for key in keys]

# Select one vertex on the boundary
boundary_keys = list(mesh.vertices_on_boundary())
boundary_keys = sorted(boundary_keys)
start = boundary_keys[start_boundary_vertex_idx]
start_vertex = artist.draw_vertices([start])

# Find the neighbours of this vertex
nbrs = mesh.vertex_neighbors(start)

# Check, if the start vertex has at least 3 neighbors
if len(nbrs) < 3:
    if start_boundary_vertex_idx==0: 
        start_boundary_vertex_idx += 1
    else:
        start_boundary_vertex_idx -= 1
    start = boundary_keys[start_boundary_vertex_idx]
    start_vertex = artist.draw_vertices([start])
    nbrs = mesh.vertex_neighbors(start)

# Visualize the vertices and labels of the neighbors at start
if show_labels_neighbors_start:
    keys = nbrs
    vertices_start_neighbors = artist.draw_vertices(vertices=keys)
    labels_start_neighbors = [key for key in keys]

# Find the neighbor not on the boundary:
current = start
for nbr in nbrs:
    print(nbr, mesh.is_vertex_on_boundary(nbr))
    if not mesh.is_vertex_on_boundary(nbr):
        previous, current = current, nbr
        break

# Find the neighbours of the new vertex in cycling order
nbrs = mesh.vertex_neighbors(current, ordered=True)

# Visualize the vertices and labels of the neighbors at current
if show_labels_neighbors_current:
    keys = nbrs
    vertices_current_neighbors = artist.draw_vertices(vertices=keys)
    labels_current_neighbors = [key for key in keys]

current_vertex = artist.draw_vertices([current])

# Find the opposite neighbour of the previous vertex
i = nbrs.index(previous)
previous, current = current, nbrs[i - 2]
print(previous, current)
nbrs = mesh.vertex_neighbors(current, ordered=True)


# ---------------------------------------------------------------------------------------------------------------------------------
# Assignment: Define a function for traversing the mesh from boundary to boundary in a "straight" line and visualise the result.
#
# 1a. Get the current neighbor keys from the start key
# 1b. Find the key in the current neighbor keys which is not on the boundary, which is the next key for the path
# 1c. Make a while loop, that finds the keys for the path until it reaches the opposite side
# ---------------------------------------------------------------------------------------------------------------------------------
start = boundary_keys[start_boundary_vertex_idx]

path = [start] # path with starting key


''' Add code here '''


# Visualize the vertices and labels of the path
if show_labels_path:
    keys = path
    vertices_path = artist.draw_vertices(vertices=keys)
    labels_path = [key for key in keys]
# ---------- end mesh_viz ----------
pt = Point(mesh_viz.vertices)
line = Line(mesh_viz.edges)
mesh = Mesh(mesh_viz.faces)
pt_2 = Point(mesh_viz.start_vertex)
pt_3 = Point(mesh_viz.vertices_start_neighbors)
pt_4 = Point(mesh_viz.vertices_path)
pt_5 = Point(mesh_viz.current_vertex)
pt_6 = Point(mesh_viz.vertices_current_neighbors)
tag = TextTag(Location=pt, Text=mesh_viz.labels, Colour=ColourSwatch(SwatchColor=RGB(0, 0, 0)))
tag_2 = TextTag(Location=pt_4, Text=mesh_viz.labels_path, Colour=ColourSwatch(SwatchColor=RGB(0, 0, 0)))
tag_3 = TextTag(Location=pt_3, Text=mesh_viz.labels_start_neighbors, Colour=ColourSwatch(SwatchColor=RGB(0, 0, 0)))
tag_4 = TextTag(Location=pt_6, Text=mesh_viz.labels_current_neighbors, Colour=ColourSwatch(SwatchColor=RGB(0, 0, 0)))
preview = CustomPreview(Geometry=[line, pt_3, pt_6], Material=ColourSwatch(SwatchColor=RGB(255, 248, 184)))
preview_2 = CustomPreview(Geometry=mesh, Material=ColourSwatch(SwatchColor=RGB(178, 178, 178)))
preview_3 = CustomPreview(Geometry=[pt_5, pt_2], Material=ColourSwatch(SwatchColor=RGB(255, 217, 217)))
preview_4 = CustomPreview(Geometry=pt_4, Material=ColourSwatch(SwatchColor=RGB(255, 120, 120)))
